# Grasshopper definition TestForOutput.gh (Grasshopper 1.0.7)
# plug-ins: Kangaroo2 Components, Pufferfish, ParkingDemo

crv = Curve(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)

crv_2 = Curve(reparameterize(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))
crv_3 = Curve(reparameterize(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))
crv_4 = Curve(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)
crv_5 = Curve(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)
crv_6 = Curve(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)
crv_7 = Curve(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)
crv_8 = Curve(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)
crv_9 = Curve(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)
crv_10 = Curve(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)
rec = Rectangle({Plane=PlaneXY(-36.17804932, 8.812579263, 0), Size=Domain2(u=-30.67905678..30.67905678, v=-35.06732629..35.06732629)})
crv_11 = Curve(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)
crv_12 = Curve(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)
crv_13 = Curve(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)
crv_14 = Curve(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)
crv_15 = Curve(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)
crv_16 = Curve(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)
crv_17 = Curve(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)
crv_18 = Curve(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)
crv_19 = Curve(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)
crv_20 = Curve(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)
crv_21 = Curve(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)
crv_22 = Curve(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)
crv_23 = Curve(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)
crv_24 = Curve(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)
crv_25 = Curve(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)
crv_26 = Curve(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)
crv_27 = Curve(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)

data = Data("Grasshopper.Kernel.Types.GH_ObjectWrapper")
data_2 = Data("Grasshopper.Kernel.Types.GH_ObjectWrapper")
data_3 = Data("Grasshopper.Kernel.Types.GH_ObjectWrapper")

crv_28 = Curve(crv_8)
regenerate_parking = Trigger(Interval=-1, TimerInterval=5, Target=pathfinder)
regenerate_ramp = Trigger(Interval=-1, TimerInterval=5, Target=outlinegrid)  # disabled
outlinegrid = OutlineGrid(AddRampToParking=Toggle(True), Outline=crv_28, Rampside=Slider(1, range=0..4))
click_to_screen_capture = Button()
pathfinder = PathFinder(ResetGeneration=Toggle(False), Parking=outlinegrid)  # -> Parking, GenerationCollection

# ---- group: save preview results
bounding_rectangle = BoundingRectangle(Geometry=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, Plane=PlaneXY(0, 0, 0), Axis=0, Slide=0, Union=True)  # -> Bounding, DimensionX, DimensionY
rectangle = Rectangle(bounding_rectangle.Bounding)
boolean_toggle = BooleanToggle(True)
offset_curve = OffsetCurve(Curve=rectangle, Distance="3", Corners=1)

# ----
trigger = Trigger(Interval=1000, TimerInterval=1000, Target=printresult)  # disabled
pathconnection = PathConnection(N1=<missing>, M1=<missing>, N2=<missing>, M2=<missing>, Matrix=<missing>)  # -> Lotgainnum, Ispathpossible
number_slider = Slider(25, range=11..25)
number_slider_2 = Slider(26, range=26..50)
deconstrucparking = DeconstrucParking(Parking=pathfinder.Parking)  # -> Score, PlanMatrix, PathPoints, LotInformations, Cells, SideCellsAddress, RampInfo
deconstrucparking_2 = DeconstrucParking(Parking=pathfinder.Parking)  # -> Score, PlanMatrix, PathPoints, LotInformations, Cells, SideCellsAddress, RampInfo
button = Button()
deconstructgenerationcollection = DeconstructGenerationCollection(GenerationCollection=pathfinder.GenerationCollection)  # -> Ids, Scores
printresult = PrintResult(OutlineBoundingRectangle=offset_curve, ResetPreviewSheet=click_to_screen_capture)
list_item = ListItem(List=deconstructgenerationcollection.Ids, Index=Slider(12, range=0..100), Wrap=True)
panel = Panel(deconstructgenerationcollection.Scores)
generalrampinformation = GeneralRampInformation()  # -> RampTypes, RampOrientations

# ----
# ramp info:
# 0: side
# 1: cell index on its side
# 2: ramp type
# 3: orientation
item = ListItem(List=deconstrucparking.RampInfo, Index=0, Wrap=True)  # -> Item, Item1, Item2, Item3

trigger_2 = Trigger(Interval=-1000, TimerInterval=1000, Target=columngridgenerator)

# ----
# path display
panel_2 = Panel("1")
trim = TrimTree(Tree=deconstrucparking.PathPoints, Depth=panel_2)
data_4 = Data(trim)
duppt = RemoveDuplicatePts(Points=data_4, Tolerance=0.01)
xy = XYPlane(Origin=Point(0, 0, 0))
pline = PolyLine(Closed=False)
join = JoinCurves(Curves=simplify(flatten(pline)), Preserve=False)
panel_3 = Panel("5")
project = Project(Geometry=pline, Plane=xy)  # -> Geometry, Transform
fillet = Fillet(Curve=join, Radius="2.5")
offset = OffsetCurve(Curve=fillet, Distance=expr("-x", ".3"), Corners=1)
offset_2 = OffsetCurve(Curve=fillet, Distance=".3", Corners=1)
panel_4 = Panel("""0.5
.4""")
dash = DashPattern(Curve=fillet, Pattern=panel_4)  # -> Dashes, Gaps
end = EndPoints(Curve=project.Geometry)  # -> Start, End
panel_5 = Panel("2")
preview = CustomPreview(Geometry=[dash.Dashes, offset_2, offset], Material=ColourSwatch(SwatchColor=RGB(158, 106, 106)))

# ----
# preview outline
cluster = Cluster()
custom_preview = CustomPreview(Geometry=cluster, Material=ColourSwatch(SwatchColor=RGB(0, 0, 0)))

branch = TreeBranch(Tree=deconstrucparking.SideCellsAddress, Path=item.Item, MaintainPaths=True)

# ----
# optimization
flatten = FlattenTree(Tree=deconstrucparking.LotInformations, Path="{0}")  # -> flatten(Tree)
lng = ListLength(List=flatten)
panel_6 = Panel(lng)
num = Number(panel_6)
galapagos = Galapagos(fitness=num)

# ----
# parking lots display
crv_29 = Curve([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])
surface = Surface([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])
rotate = Rotate(Geometry=crv_29, Angle=degrees("180"), Plane=PlaneXY(0, 0, 0))  # -> Geometry, Transform
rotate_2 = Rotate(Geometry=surface, Angle=degrees("180"), Plane=PlaneXY(0, 0, 0))  # -> Geometry, Transform
crv_30 = Curve(rotate_2.Geometry)
transform = Transform(Geometry=rotate.Geometry, Transform=deconstrucparking.LotInformations)
transform_2 = Transform(Geometry=rotate_2.Geometry, Transform=deconstrucparking.LotInformations)
data_5 = Data(transform)
data_6 = Data(transform_2)
preview_2 = CustomPreview(Geometry=data_5, Material=ColourSwatch(SwatchColor=RGB(9, 10, 9)))
preview_3 = CustomPreview(Geometry=data_6, Material=ColourSwatch(SwatchColor=RGB(200, 224, 202)))

panel_7 = Panel("""0.3
0.5
0.2""")
data_7 = Data()
dash_2 = DashPattern(Curve=data_7, Pattern=panel_7)  # -> Dashes, Gaps

# ----
# path display
curve = Curve(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)
data_8 = Data(trim)
area = Area(Geometry=curve)  # -> Area, Centroid
subtraction = Subtraction(A=data_8, B=area.Centroid)
surface_2 = Surface(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)
graft_tree = GraftTree(Tree=subtraction, IncludeEmptyLists=True, IncludeNullItems=True)
move = Move(Geometry=surface_2, Motion=graft_tree)  # -> flatten(Geometry), Transform
custom_preview_2 = CustomPreview(Geometry=move.Geometry, Material=ColourSwatch(SwatchColor=RGB(135, 161, 106)))

# ----
# column grid
columngridgenerator = ColumnGridGenerator(Parking=pathfinder.Parking)  # -> H, V, Parking
construct_point = ConstructPoint(XCoordinate=graft(columngridgenerator.V), YCoordinate=columngridgenerator.H, ZCoordinate=0)
panel_8 = Panel(columngridgenerator.V)
point_in_curve = PointInCurve(Point=construct_point)  # -> Relationship, Point
equality = Equality(FirstNumber=point_in_curve.Relationship, SecondNumber="0")  # -> Equality, Inequality
dispatch = Dispatch(List=construct_point, DispatchPattern=equality.Inequality)  # -> ListA, ListB
data_9 = Data(dispatch.ListA)

# ----
# column plane center
division = Division(A="0.5", B=-2)
unit_x = UnitX(Factor=division)
unit_y = UnitY(Factor=division)
addition = Addition(A=unit_x, B=unit_y)
move_2 = Move(Geometry=data_9, Motion=addition)  # -> Geometry, Transform

rectangle_2 = Rectangle(Plane=move_2.Geometry, XSize="0.5", YSize="0.5", Radius=0)  # -> Rectangle, Length
surface_3 = Surface(rectangle_2.Rectangle)

custom_preview_3 = CustomPreview(Geometry=surface_3, Material=ColourSwatch(SwatchColor=RGB(0, 15, 51)))

branch_2 = TreeBranch(Tree=generalrampinformation.RampTypes, Path=item.Item2, MaintainPaths=True)
number_slider_3 = Slider(5, range=0..10)
multiplication = Multiplication(A=branch_2, B=5)
item_2 = ListItem(List=branch, Index=item.Item1, Wrap=True)
addition_2 = Addition(A=multiplication, B=item_2, C="{-2.5,-2.5,0}")
rectangle_3 = Rectangle(Plane=addition_2, XSize=number_slider_3, YSize=number_slider_3, Radius=0)  # -> Rectangle, Length
item_3 = ListItem(List=rectangle_3.Rectangle, Index=0, Wrap=True)
boundary = BoundarySurfaces(Edges=rectangle_3.Rectangle)
lng_2 = ListLength(List=rectangle_3.Rectangle)
area_2 = Area(Geometry=item_3)  # -> Area, Centroid
move_3 = Move(Geometry=boundary, Motion=expr("-x", area_2.Centroid))  # -> Geometry, Transform
range = Range(Domain="0 to 0.8", Steps=expr("x-1", lng_2))  # -> reverse(Range)
item_4 = ListItem(List=generalrampinformation.RampOrientations, Index=item.Item3, Wrap=True)
gradient = Gradient(LowerLimit=0, UpperLimit=1, Parameter=range, stops=[0: RGB(192, 0, 0), 0: RGB(255, 255, 255), 1: RGB(128, 128, 128)])
transform_3 = Transform(Geometry=move_3.Geometry, Transform=item_4)
move_4 = Move(Geometry=transform_3, Motion=area_2.Centroid)  # -> Geometry, Transform
preview_4 = CustomPreview(Geometry=move_4.Geometry, Material=gradient)

geo = Geometry([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])
join_2 = JoinCurves(Curves=geo, Preserve=False)
geo_2 = Geometry([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])
geo_3 = Geometry([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])
geo_4 = Geometry([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])
geo_5 = Geometry([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])
geo_6 = Geometry([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])
group = Group(Objects=geo)
group_2 = Group(Objects=geo_4)
group_3 = Group(Objects=geo_3)
group_4 = Group(Objects=geo_6)
group_5 = Group(Objects=geo_5)
group_6 = Group(Objects=geo_2)
merge = Merge(Data1=group, Data2=group_2, Data3=group_3, Data4=group_4, Data5=group_5, Data6=group_6)
item_5 = ListItem(List=merge, Index=item.Item2, Wrap=True)
scale = Scale(Geometry=item_5, Center=Point(0, 0, 0), Factor="5")  # -> Geometry, Transform
move_5 = Move(Geometry=scale.Geometry, Motion="{-2.5,-2.5,0}")  # -> Geometry, Transform
rotate_3 = Rotate(Geometry=move_5.Geometry, Angle="pi/2", Plane=PlaneXY(0, 0, 0))  # -> Geometry, Transform

transform_4 = Transform(Geometry=rotate_3.Geometry, Transform=item_4)
move_6 = Move(Geometry=transform_4, Motion=area_2.Centroid)  # -> Geometry, Transform
preview_5 = CustomPreview(Geometry=move_6.Geometry, Material=ColourSwatch(SwatchColor=RGB(186, 168, 168)))

# ----
# Plan Geometric Output
plancells = Data(data_7)
cars = Data(data_6)
ramp = Data(move_6.Geometry)

custom_preview_4 = CustomPreview(Geometry=cars, Material=ColourSwatch(SwatchColor=RGBA(194, 128, 128, 67)))

# ----
# Get Matrix Element In Plan Displayer
deconstruct_matrix = DeconstructMatrix(Matrix=deconstrucparking.PlanMatrix)  # -> Rows, Columns, Values
plasticanchor = PlasticAnchor(Limit=1, Strength=1, Reset=False)
partition_list = PartitionList(List=deconstruct_matrix.Values, Size=deconstruct_matrix.Columns)
data_10 = Data(data_7)
area_3 = Area(Geometry=data_10)  # -> Area, Centroid
partition_list_2 = PartitionList(List=partition_list, Size="1")  # -> simplify(Chunks)

# ---- group: to remove 0 items in matrix
# we remove 0 items in matrix so the
# remained cells in matrix are equal to plan
# cells and the data is reconstructed based
#  on plan
equality_2 = Equality(FirstNumber=partition_list_2, SecondNumber=0)  # -> Equality, Inequality
tree_statistics = TreeStatistics(Tree=partition_list_2)  # -> Paths, Length, Count
dispatch_2 = Dispatch(List=tree_statistics.Paths, DispatchPattern=flatten(equality_2.Inequality))  # -> ListA, ListB
tree_branch = TreeBranch(Tree=partition_list_2, Path=dispatch_2.ListA, MaintainPaths=True)

# ----
# add path of each cell for detection
tree_statistics_2 = TreeStatistics(Tree=area_3.Centroid)  # -> Paths, Length, Count
tree_branch_2 = TreeBranch(Tree=partition_list_2, Path=tree_statistics_2.Paths, MaintainPaths=True)
move_7 = Move(Geometry=area_3.Centroid, Motion="-1.7,-1.7,0")  # -> Geometry, Transform
tree_statistics_3 = TreeStatistics(Tree=tree_branch_2)  # -> Paths, Length, Count
panel_10 = Panel("1")

text_tag_3d = TextTag3D(
    Location=move_7.Geometry,
    Text=graft(tree_statistics_3.Paths),
    Size="0.5",
    Colour=ColourSwatch(SwatchColor=RGB(0, 0, 0)),
    Justification=5)

# ==== cluster Cluster
curve = ClusterInput()
data = ClusterInput()
simplify_curve = SimplifyCurve(Curve=curve)  # -> Curve, Simplified
data_2 = Data(data)
offset_curve = OffsetCurve(Curve=simplify_curve.Curve, Distance=".3", Corners=1)
end_points = EndPoints(Curve=simplify_curve.Curve)  # -> Start, End
end_points_2 = EndPoints(Curve=offset_curve)  # -> Start, End
line = Line(StartPoint=end_points_2.Start, EndPoint=end_points.Start)
sweep2 = Sweep2(Rail1=simplify_curve.Curve, Rail2=offset_curve, Sections=line, SameHeight=False)
brep = ClusterOutput(sweep2)
